vi "List Packages.gvi"   [LabVIEW NXG Preview 4.0.0]
# Perform a Get TestResults request on the Web Service
inputs:
  "Connection in": "Connection--cluster.gtype", required
  "error in": error
  "PageNumber": i32 = 1, required
  "SearchCriteria": string
outputs:
  "Connection out": "Connection--cluster.gtype"
  "error out": error
  "Packages": "Package--cluster.gtype"[]
  "List Details": "List Details--cluster.gtype"
types:
  "Client Handle.gtype" = u32
  "Connection--cluster.gtype" = cluster{"client handle": "Client Handle.gtype", "Root URL": string}
  "Package Version.gtype" = cluster{"Version Number": "Version Number--cluster.gtype", "Version Text": string, "ReleaseDate": string, "DisplayName": string, "Description": string, "Summary": string, "Copyright": string, "Vendor": string, "Author": string, "Release Notes": string, "Dependencies": string[], "IconURL": string, "PackageURL": string}
  "Package--cluster.gtype" = cluster{"Name": string, "DisplayName": string, "RepoType": string, "RepoName": string, "Versions": "Package Version.gtype"[]}
  "List Details--cluster.gtype" = cluster{"TotalPackages": i32, "TotalPages": i32, "PagesBefore": i32, "PagesAfter": i32, "ItemsPerPage": i32}
  T1 = cluster{"PageNumber": i32, "SearchCriteria": string}
  T2 = cluster{"TotalPackages": i32, "TotalPages": i32, "PagesBefore": i32, "PagesAfter": i32, "ItemsPerPage": i32, "Packages": "Package--cluster.gtype"[]}
uses:
  HTTP Client API::Connection::POST.gvi
diagram:
  Property Node(instance in=T1 {all zero or empty}, "PageNumber"=$PageNumber, "SearchCriteria"=$SearchCriteria) -> (instance out=w1)
  Flatten To JSON(anything=w1) -> (JSON string=w2)
  call "POST.gvi"(Connection in=$"Connection in", Method name="Packages/List", buffer=w2, error in=$"error in") -> (Connection out=w3, body=w4, error out=w5)
  $"Connection out" <- w3
  Unflatten From JSON(JSON string=w4, error in (no error)=w5, type and defaults=T2 {all zero or empty}) -> (error out=w6, value=w7)
  $"error out" <- w6
  Property Node(instance in=w7) -> ("Packages"=w8, "TotalPackages"=w9, "TotalPages"=w10, "PagesBefore"=w11, "PagesAfter"=w12, "ItemsPerPage"=w13)
  $Packages <- w8
  Property Node(instance in="List Details--cluster.gtype" {all zero or empty}, "TotalPackages"=w9, "TotalPages"=w10, "PagesBefore"=w11, "PagesAfter"=w12, "ItemsPerPage"=w13) -> (instance out=w14)
  $"List Details" <- w14
