vi "PackageDetails.gviweb"   [LabVIEW NXG 4.0.0]
panel controls:
  "Download": bool
  "Version": i32
panel indicators:
  "URL Image": string
  "DisplayName": string
  "PkgIcon": string
  "ReleaseDate": string
  "Vendor": string
  "Author": string
  "Description": string
  "Release Notes": string
  "Dependencies": string
  "PrototypedBy": string
  "Name": string
  "GPM Install Command:": string
types:
  "Package Version--cluster.gtype" = cluster{"ReleaseDate": string, "Version": string, "Name": string, "DisplayName": string, "Description": string, "Vendor": string, "Author": string, "Release Notes": string, "Dependencies": string[], "IconURL": string, "PackageURL": string, "RepoType": string, "RepoName": string}
  T1 = cluster{"BaseURL": string, "Package Details": "Package Version--cluster.gtype", "All Versions": string[]}
uses:
  QMH support::Message Queue::Create All Message Queues.gviweb
  HTTP Client API::Base URL--constant.gvi
  QMH support::Message Queue::Dequeue Message.gviweb
  QMH support::Message Queue::Enqueue Message (Single).gviweb
  BusyStateAPI::Set Busy.gviweb
  HTTP Client API::Connection::Open Connection.gvi
  HTTP Client API::Packages::Get Package Details.gvi
  HTTP Client API::Packages::Get All Package Versions.gvi
  HTTP Client API::Connection::Close Connection.gvi
  BusyStateAPI::Unset Busy.gviweb
  WebApp::Support::JSON Timestamp to Display.gvi
  WebApp::Support::Join Strings.gvi
  QMH support::Message Queue::Enqueue Message (Array).gviweb
  WebApp::Support::RepoType string to enum.gvi
  WebApp::Support::Generate GPM Install Command.gvi
  RedirectURL::Redirect.jsli::Redirect
  HTTP Client API::Packages::Set Package.gvi
  WebApp::Support::GPM Install Instructions URL--constant.gvi
  NI::G Core::Error::Read Error Code.gvi
  Error Handling::Error Handler.gvi
  NI::G Core::Error::Build Error Cluster.gvi
  QMH support::Error Handler - Message Handling Loop.gviweb
  QMH support::Error Handler - Event Handling Loop.gviweb
diagram:
  w1 = bool TRUE  # Stop Event
  Create User Event[EventName="Stop Event"](user event data type=w1) -> (error out=w2, user event out=w3)
  call "Create All Message Queues.gviweb"(error in=w2) -> (message queues=w4, error out=w5)
  call "Base URL--constant.gvi"() -> (Base URL=w6)
  Property Node(instance in=T1 {all zero or empty}, "BaseURL"=w6) -> (instance out=w7)
  Property Node(instance in=w4) -> ("UI"=w8)
  s1 = w7  # shift register
  while {
    call "Dequeue Message.gviweb"(message queue in=w8, error in=w5) -> (message queue out=w9, message=w10, message data=w11, error out=w12)
    # s1: Data
    # w3: Stop Event
    case (w10) ignore case {  # Message Cases
      frame "Initialize" {
        call "Enqueue Message (Single).gviweb"(message queue in=w9, message="Get Package Details", error in=w12) -> (error out=w13)
        w14 = s1
        w15 = default
      }
      frame "Get Package Details" {
        Property Node(instance in=s1) -> ("BaseURL"=w16, instance out=w17)
        call "Set Busy.gviweb"(error in=w12) -> (error out=w18)
        call "Open Connection.gvi"(Root URL=w16, error in=w18) -> (Connection=w19, error out=w20)
        call "Get Package Details.gvi"(Connection in=w19, error in=w20) -> (Connection out=w21, Package Details=w22, error out=w23)
        call "Get All Package Versions.gvi"(Connection in=w21, error in=w23) -> (Connection out=w24, All Versions text=w25, error out=w26)
        Property Node(instance in=w17, "Package Details"=w22, "All Versions"=w25) -> (instance out=w14)
        call "Close Connection.gvi"(Connection in=w24, error in=w26) -> (error out=w27)
        call "Unset Busy.gviweb"(error in=w27) -> (error out=w28)
        call "Enqueue Message (Single).gviweb"(message queue in=w9, message="Display Package Details", error in=w28) -> (error out=w13)
        w15 = default
      }
      frame "Display Package Details" {
        Property Node(instance in=s1) -> ("Package Details"=w29, instance out=w14)
        Property Node(instance in=w29) -> ("Name"=w30, "DisplayName"=w31, "IconURL"=w32, "ReleaseDate"=w33, "Vendor"=w34, "Author"=w35, "Description"=w36, "Release Notes"=w37, "Dependencies"=w38)
        $Name <- w30
        $DisplayName <- w31
        $PkgIcon <- w32
        call "JSON Timestamp to Display.gvi"(JSON Timestamp=w33) -> (Display Timestamp=w39)
        $ReleaseDate <- w39
        $Vendor <- w34
        $Author <- w35
        $Description <- w36
        $"Release Notes" <- w37
        call "Join Strings.gvi"(String Array Input=w38, Separator="\r\n") -> (String output=w40)
        $Dependencies <- w40
        call "Enqueue Message (Array).gviweb"(message queue in=w9, message array=["Display Versions", "Display Download Instructions"], error in=w12) -> (error out=w13)
        w15 = default
      }
      frame "Display Versions" {
        Property Node(instance in=s1) -> ("All Versions"=w41, "Package Details:Version"=w42, instance out=w14)
        Search 1D Array(1D array=w41, element=w42) -> (index of element=w43)
        Property Node(instance in=reference to "Version", "Items"=w41, "Value"=w43)
        w13 = w12
        w15 = default
      }
      frame "Display Download Instructions" {
        Property Node(instance in=s1) -> ("Package Details"=w44, instance out=w14)
        Property Node(instance in=w44) -> ("RepoType"=w45)
        call "RepoType string to enum.gvi"(RepoType string=w45) -> (RepoType=w46)
        case (w46) {
          frame "VIPM", Default {
            w47 = "Download Package"
            w48 = default
            w49 = default
          }
          frame "GPM" {
            call "Generate GPM Install Command.gvi"(Package Version=w44) -> (GPM Install Command=w49)
            w47 = "GPM Install Instructions"
            w48 = TRUE
          }
        }
        Build Array(w47, w47) -> w50
        Property Node(instance in=reference to "Download", "Text"=w50)
        Property Node(instance in=reference to "GPM Install Command:", "Visible"=w48, "Value"=w49)
        w13 = w12
        w15 = default
      }
      frame "Version changed" {
        Property Node(instance in=s1) -> ("BaseURL"=w51, "Package Details:Name"=w52, "All Versions"=w53, instance out=w14)
        call "Set Busy.gviweb"(error in=w12) -> (error out=w54)
        Decimal String To Number(string=w11) -> (number=w55)
        Array Index(array=w53) -> (out0[w55]=w56)
        Format Into String(formatString="%sPackage?Name=%s&Version=%s", w51, w52, w56) -> w57
        disable {
          frame Enabled {
            call "Redirect"(URL=w57, target="_parent", error in=w54) -> (error out=w58)
          }
          frame Disabled {
            call "Open Connection.gvi"(Root URL=w51, error in=w54) -> (Connection=w59, error out=w60)
            call "Set Package.gvi"(Connection in=w59, Name=w52, Version=w56, error in=w60) -> (Connection out=w61, error out=w62)
            call "Close Connection.gvi"(Connection in=w61, error in=w62) -> (error out=w63)
            call "Enqueue Message (Single).gviweb"(message queue in=w9, message="Get Package Details", error in=w63) -> (error out=w58)
          }
        }
        call "Unset Busy.gviweb"(error in=w58) -> (error out=w13)
        w15 = default
      }
      frame "Download Package" {
        call "Set Busy.gviweb"(error in=w12) -> (error out=w64)
        Property Node(instance in=s1) -> ("Package Details:PackageURL"=w65, "Package Details:RepoType"=w66, instance out=w14)
        call "RepoType string to enum.gvi"(RepoType string=w66) -> (RepoType=w67)
        case (w67) {
          frame "VIPM", Default {
            w68 = w65
          }
          frame "GPM" {
            call "GPM Install Instructions URL--constant.gvi"() -> (GPM Install Instructions URL=w68)
          }
        }
        call "Redirect"(URL=w68, target="_blank", error in=w64) -> (error out=w69)
        call "Unset Busy.gviweb"(error in=w69) -> (error out=w13)
        w15 = default
      }
      frame "Error" {
        # Process Error
        w70 = no error  # Error
        Unflatten From JSON(JSON string=w11, error in (no error)=w12, type and defaults=w70) -> (error out=w13, value=w71)
        call "Read Error Code.gvi"(error in=w71) -> (code=w72)
        case (w72) {
          frame 501401 {
            # Redirect to Login page
            call "Redirect"(URL="Login.html")
          }
          frame 0, Default {
            # Display Error
            call "Error Handler.gvi"(error in=w71)
          }
        }
        w14 = s1
        w15 = default
      }
      frame "---Copy This Frame---" {
        Merge Errors(w12) -> (error out=w13)
        w14 = s1
        w15 = default
      }
      frame "Exit" {
        # Release the message queue reference
        Release Queue(error in=w12, queue=w9) -> (error out=w73)
        Generate User Event(event data=TRUE, user event=w3) -> (error out=w74)
        Merge Errors(w74, w73) -> (error out=w13)
        # Stop the VI
        w14 = s1
        w15 = TRUE
      }
      frame Default {
        w75 = "The invalid message string \"%s\" was received in the Message Handling Loop."
        Format Into String(formatString=w75, w10) -> w76
        call "Build Error Cluster.gvi"(code=1, description=w76) -> (error out=w13)
        w14 = s1
        w15 = default
      }
    }
    call "Error Handler - Message Handling Loop.gviweb"(message queue in=w9, error in=w13) -> (dup error in=w77)
    next s1 = w14
    stop if w15
  }
  Register For Events("Stop Event"=w3) -> (event registration refnum out=w78)
  s2 = w78  # shift register
  while {
    event (dynamic events = s2) {
      on dynamic event 0 {
        # The Message Handling Loop processed an "Exit" message, which fired this event to stop the Event Handling Loop.
        w79 = TRUE
        w80 = no error
        w81 = w8
      }
      on "Download" Value changed {
        call "Enqueue Message (Single).gviweb"(message queue in=w8, message="Download Package") -> (message queue out=w81, error out=w80)
        w79 = default
      }
      on "Version" Value changed {
        Event Data() -> ("New Value"=w82)
        Number To Decimal String(number=w82) -> (decimal integer string=w83)
        call "Enqueue Message (Single).gviweb"(message queue in=w8, message="Version changed", message data=w83) -> (message queue out=w81)
        w79 = default
        w80 = default
      }
    }
    call "Error Handler - Event Handling Loop.gviweb"(message queue in=w81, error in=w80) -> (dup error in=w84)
    stop if w79
  }
  Unregister For Events(error in=w84, event registration refnum=s2) -> (error out=w85)
  Merge Errors(w85, w77) -> (error out=w86)
  Destroy User Event(error in=w86, user event=w3)
