vi "Build Status String.gvi"   [LabVIEW NXG Preview 4.0.0]
inputs:
  "List Packages Settings": "List Packages Settings--cluster.gtype" = {"PageNumber"=1, "SearchCriteria"=""}, required
  "List Details": "List Details--cluster.gtype", required
outputs:
  "Status String": string
types:
  "List Packages Settings--cluster.gtype" = cluster{"PageNumber": i32, "SearchCriteria": string}
  "List Details--cluster.gtype" = cluster{"TotalPackages": i32, "TotalPages": i32, "PagesBefore": i32, "PagesAfter": i32, "ItemsPerPage": i32}
diagram:
  Property Node(instance in=$"List Details") -> ("ItemsPerPage"=w1, "TotalPackages"=w2)
  Property Node(instance in=$"List Packages Settings") -> ("PageNumber"=w3)
  Decrement(x=w3) -> w4
  Multiply(w4, w1) -> w5
  Increment(x=w5) -> w6
  In Range And Coerce[IncludeHighLimit=True](lower limit=0, upper limit=w2, x=w6) -> (coerced(x)=w7)
  Add(w5, w1) -> w8
  In Range And Coerce[IncludeHighLimit=True](lower limit=0, upper limit=w2, x=w8) -> (coerced(x)=w9)
  Format Into String(formatString="Showing items %d to %d\n\nTotal: %d", w7, w9, w2) -> w10
  $"Status String" <- w10
