vi "Format Packages for Tree Display.gvi"   [LabVIEW NXG Preview 4.0.0]
inputs:
  "Packages": "Package--cluster.gtype"[], required
  "error in": error
outputs:
  "Packages Tree": T1[]
  "error out": error
  "All Tags": string[]
  "All Indexes": cluster{"Element 1": i32, "Element 2": i32}[]
types:
  "Package Version.gtype" = cluster{"Version Number": "Version Number--cluster.gtype", "Version Text": string, "ReleaseDate": string, "DisplayName": string, "Description": string, "Summary": string, "Copyright": string, "Vendor": string, "Author": string, "Release Notes": string, "Dependencies": string[], "IconURL": string, "PackageURL": string}
  "Package--cluster.gtype" = cluster{"Name": string, "DisplayName": string, "RepoType": string, "RepoName": string, "Versions": "Package Version.gtype"[]}
  T1 = cluster{"Element 0": string, "Element 1": string}
uses:
  WebApp::Support::JSON Timestamp to Display.gvi
diagram:
  for (iteration -> i1) {
    w1 = each element of $Packages
    Property Node(instance in=w1) -> ("DisplayName"=w5, "Versions"=w6)
    for (iteration -> i2) {
      w7 = each element of w6
      Property Node(instance in=w7) -> ("Version Text"=w12, "ReleaseDate"=w13, "Vendor"=w14)
      Concatenate Strings(w5, "\\", w12) -> w15
      call "JSON Timestamp to Display.gvi"(JSON Timestamp=w13) -> (Display Timestamp=w16)
      Build Array(w15, w16) -> w17
      Array To Cluster[NumberOfClusterElements=2](array=w17) -> (cluster=w18)
      Build Cluster(i1, i2) -> w19
      append w18 to w8
      append w14 to w9
      append w15 to w10
      append w19 to w11
    }
    Array Index(array=w9) -> (out0[_]=w20)
    Build Array(w5, w20) -> w21
    Array To Cluster[NumberOfClusterElements=2](array=w21) -> (cluster=w22)
    Build Array(w22, w8) -> w23
    Build Array(w5, w10) -> w24
    Build Cluster(i1, -1) -> w25
    Build Array(w25, w11) -> w26
    concatenate w23 onto w2
    concatenate w24 onto w3
    concatenate w26 onto w4
  }
  $"Packages Tree" <- w2
  $"All Tags" <- w3
  $"All Indexes" <- w4
  $"error out" <- $"error in"
