vi "index.gviweb"   [LabVIEW NXG 4.0.0]
panel controls:
  "Packages": bool
panel indicators:
  "URL Image": string
  "PrototypedBy": string
uses:
  QMH support::Message Queue::Create All Message Queues.gviweb
  HTTP Client API::Base URL--constant.gvi
  QMH support::Message Queue::Dequeue Message.gviweb
  HTTP Client API::Website Version.gvi
  HTTP Client API::Connection::Open Connection.gvi
  HTTP Client API::WebServices Version.gvi
  HTTP Client API::Connection::Close Connection.gvi
  RedirectURL::Redirect.jsli::Redirect
  NI::G Core::Error::Read Error Code.gvi
  Error Handling::Error Handler.gvi
  NI::G Core::Error::Build Error Cluster.gvi
  QMH support::Error Handler - Message Handling Loop.gviweb
  QMH support::Message Queue::Enqueue Message (Single).gviweb
  QMH support::Error Handler - Event Handling Loop.gviweb
diagram:
  w1 = bool TRUE  # Stop Event
  Create User Event[EventName="Stop Event"](user event data type=w1) -> (error out=w2, user event out=w3)
  call "Create All Message Queues.gviweb"(error in=w2) -> (message queues=w4, error out=w5)
  call "Base URL--constant.gvi"() -> (Base URL=w6)
  Property Node(instance in=cluster{"BaseURL": string} {all zero or empty}, "BaseURL"=w6) -> (instance out=w7)
  Property Node(instance in=w4) -> ("UI"=w8)
  s1 = w7  # shift register
  while {
    call "Dequeue Message.gviweb"(message queue in=w8, error in=w5) -> (message queue out=w9, message=w10, message data=w11, error out=w12)
    # s1: Data
    # w3: Stop Event
    case (w10) ignore case {  # Message Cases
      frame "Initialize" {
        Set Busy(reference in=reference to unnamed front panel, error in=w12) -> (reference out=w16, error out=w17)
        call "Website Version.gvi"(error in=w17) -> (Version=w18, error out=w19)
        Property Node(instance in=s1) -> ("BaseURL"=w20, instance out=w14)
        call "Open Connection.gvi"(Root URL=w20, error in=w19) -> (Connection=w21, error out=w22)
        call "WebServices Version.gvi"(Connection in=w21, error in=w22) -> (Connection out=w23, version=w24, error out=w25)
        Format Into String(formatString="Website version: %s\nWebServices version: %s", w18, w24) -> w26
        Property Node(instance in=reference to unnamed text, "Text"=w26)
        call "Close Connection.gvi"(Connection in=w23, error in=w25) -> (error out=w27)
        Unset Busy(reference in=w16, error in=w27) -> (error out=w13)
        w15 = default
      }
      frame "Packages" {
        call "Redirect"(URL="Packages.html", target="_self", error in=w12) -> (error out=w13)
        w14 = s1
        w15 = default
      }
      frame "Error" {
        # Process Error
        w28 = no error  # Error
        Unflatten From JSON(JSON string=w11, error in (no error)=w12, type and defaults=w28) -> (error out=w13, value=w29)
        call "Read Error Code.gvi"(error in=w29) -> (code=w30)
        case (w30) {
          frame 501401 {
            # Redirect to Login page
            call "Redirect"(URL="Login.html")
          }
          frame 0, Default {
            # Display Error
            call "Error Handler.gvi"(error in=w29)
          }
        }
        w14 = s1
        w15 = default
      }
      frame "---Copy This Frame---" {
        Merge Errors(w12) -> (error out=w13)
        w14 = s1
        w15 = default
      }
      frame "Exit" {
        # Release the message queue reference
        Release Queue(error in=w12, queue=w9) -> (error out=w31)
        Generate User Event(event data=TRUE, user event=w3) -> (error out=w32)
        Merge Errors(w32, w31) -> (error out=w13)
        # Stop the VI
        w14 = s1
        w15 = TRUE
      }
      frame Default {
        w33 = "The invalid message string \"%s\" was received in the Message Handling Loop."
        Format Into String(formatString=w33, w10) -> w34
        call "Build Error Cluster.gvi"(code=1, description=w34) -> (error out=w13)
        w14 = s1
        w15 = default
      }
    }
    call "Error Handler - Message Handling Loop.gviweb"(message queue in=w9, error in=w13) -> (dup error in=w35)
    next s1 = w14
    stop if w15
  }
  Register For Events("Stop Event"=w3) -> (event registration refnum out=w36)
  s2 = w36  # shift register
  while {
    event (dynamic events = s2) {
      on dynamic event 0 {
        # The Message Handling Loop processed an "Exit" message, which fired this event to stop the Event Handling Loop.
        w37 = TRUE
        w38 = no error
        w39 = w8
      }
      on "Packages" Value changed {
        call "Enqueue Message (Single).gviweb"(message queue in=w8, message="Packages") -> (message queue out=w39, error out=w38)
        w37 = default
      }
    }
    call "Error Handler - Event Handling Loop.gviweb"(message queue in=w39, error in=w38) -> (dup error in=w40)
    stop if w37
  }
  Unregister For Events(error in=w40, event registration refnum=s2) -> (error out=w41)
  Merge Errors(w41, w35) -> (error out=w42)
  Destroy User Event(error in=w42, user event=w3)
